# Grasshopper definition TreeD.gh (Grasshopper 1.0.7)

brep = Brep(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)
brep_2 = Brep(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)

brep_3 = Brep(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)
brep_4 = Brep(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)

brep_5 = Brep(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)
brep_6 = Brep(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)

rotation_jitter = Slider(0, range=0..360)
curve = Curve(<curve referenced from the Rhino model>)
spacing_btw_trees = Slider(5, range=0..100)
spacing_jitter = Slider(0, range=0..20)
path_jitter = Slider(0, range=0..100)
tree1 = Geometry(graft([brep_2, brep]))
tree2 = Geometry(graft([brep_5, brep_6]))
tree3 = Geometry(graft([brep_3, brep_4]))

treed = TreeD(
    curve=<geometry referenced from the Rhino model>,
    spacingbtwtrees=5,
    spacingjitter=0,
    pathjitter=0,
    rotationjitter=0,
    trees=[tree1, tree2, tree3])

# ==== cluster TreeD: Creates Trees and Landscape along defined path.
pathjitter = ClusterInput()
rotationjitter = ClusterInput()
spacingjitter = ClusterInput()
trees = ClusterInput()  # Geometry of the Trees/Planation
spacingbtwtrees = ClusterInput()
curve = ClusterInput()

# ---- group: SPACING JITTER
length = Length(Curve=curve)
construct_domain = ConstructDomain(DomainStart=expr("-X", spacingjitter), DomainEnd=spacingjitter)
integer_division = IntegerDivision(A=length, B=spacingbtwtrees)
divide_curve = DivideCurve(Curve=curve, Count=integer_division, Kinks=False)  # -> Points, Tangents, Parameters
random = Random(Range=construct_domain, Number=expr("X+1", integer_division), Seed=2, Integers=True)
multiplication = Multiplication(A=divide_curve.Tangents, B=random)
perp_frame = PerpFrame(Curve=curve, Parameter=divide_curve.Parameters)
deconstruct_plane = DeconstructPlane(Plane=perp_frame)  # -> Origin, XAxis, YAxis, ZAxis
construct_plane = ConstructPlane(Origin=deconstruct_plane.Origin, XAxis=deconstruct_plane.XAxis, YAxis=deconstruct_plane.ZAxis)
move = Move(Geometry=construct_plane, Motion=multiplication)  # -> Geometry, Transform

# ---- group: Path Jitter
construct_domain_2 = ConstructDomain(DomainStart=expr("-X", pathjitter), DomainEnd=pathjitter)
random_2 = Random(Range=construct_domain_2, Number=expr("X+1", integer_division), Seed=2, Integers=True)
unit_z = UnitZ(Factor=1)
cross_product = CrossProduct(VectorA=divide_curve.Tangents, VectorB=unit_z, Unitize=False)  # -> Vector, Length
multiplication_2 = Multiplication(A=cross_product.Vector, B=random_2)
move_2 = Move(Geometry=move.Geometry, Motion=multiplication_2)  # -> Geometry, Transform

# ---- group: Rotation Jitter
construct_domain_3 = ConstructDomain(DomainStart=expr("-X", rotationjitter), DomainEnd=rotationjitter)
random_3 = Random(Range=construct_domain_3, Number=integer_division, Seed=2, Integers=True)
deconstruct_plane_2 = DeconstructPlane(Plane=move_2.Geometry)  # -> Origin, XAxis, YAxis, ZAxis
radians = Radians(Degrees=random_3)
rotate = Rotate(Geometry=move_2.Geometry, Angle=radians, Plane=deconstruct_plane_2.Origin)  # -> Geometry, Transform

# ---- group: Placing Geometry on Path
list_length = ListLength(List=rotate.Geometry)
value_list = ValueList({"Square": 0, "Ball": 1, "Round": 2}, selected=["Square", "Ball", "Round"])
list_length_2 = ListLength(List=value_list)  # -> expr("x-1", Length)
random_4 = Random(Range=list_length_2, Number=list_length, Seed="0", Integers=True)
list_item = ListItem(List=trees, Index=random_4, Wrap=True)
orient = Orient(Geometry=list_item, Source=PlaneXY(0, 0, 0), Target=rotate.Geometry)  # -> Geometry, Transform

# ----
explode_tree = ExplodeTree(Data=orient.Geometry)  # -> Branch0, Branch1
geometry = Geometry(explode_tree.Branch0)
geometry_2 = Geometry(explode_tree.Branch1)
custom_preview = CustomPreview(Geometry=geometry_2, Material=ColourSwatch(SwatchColor=RGB(129, 126, 56)))
custom_preview_2 = CustomPreview(Geometry=geometry, Material=ColourSwatch(SwatchColor=RGB(137, 227, 111)))
trees_2 = ClusterOutput([geometry, geometry_2])
